# Grasshopper definition Assignment[1].gh (Grasshopper 1.0.7)
# plug-ins: V-Ray For Grasshopper 7

# ---- group: Rectangle 01
box = DomainBox(Base=PlaneXY(0, 0, 0), X=Slider(100, range=0..1000), Y=Slider(1000, range=0..1000), Z=Slider(100, range=0..100))
series = Series(Start=0, Step=1, Count=Slider(12, range=0..100))
filedge = FilletEdge(Shape=box, Blend=0, Metric=0, Edges=series, Radii=Slider(31, range=0..100))
xy = XYPlane(Origin=Point(0, 0, 0))
Z = UnitZ(Factor=1)
mirror = Mirror(Geometry=filedge, Plane=xy)  # -> Geometry, Transform
multiplication = Multiplication(A=Z, B=Slider(100, range=0..100))
rotate = Rotate(Angle=1.570796327, Plane=PlaneXY(0, 0, 0))  # -> Geometry, Transform
move = Move(Geometry=mirror.Geometry, Motion=multiplication)  # -> Geometry, Transform
debrep = DeconstructBrep(Brep=box)  # -> Faces, Edges, Vertices
crv = Curve(debrep.Edges)
cull_i = CullIndex(
    List=debrep.Faces,
    Indices=[Slider(0, range=0..9), Slider(2, range=0..9), Slider(1, range=0..9), Slider(3, range=0..9)],
    Wrap=True)
curvepoint = PointOnCurve(crv, parameter=1)
cull_i_2 = CullIndex(List=debrep.Faces, Indices=[Slider(0, range=0..9), Slider(2, range=0..9)], Wrap=True)
points = PointList(Points=curvepoint, Size=Slider(10, range=0..10))

# ---- group: Left Lights
rectangle = Rectangle(Plane=PlaneXY(0, 0, 0), XSize=Domain(-1, 1), YSize=Domain(-2, 2), Radius=0)  # -> Rectangle, Length
series_2 = Series(Start=Slider(0, range=0..1000), Step=Slider(2, range=0..100), Count=Slider(20, range=0..100))
Y = UnitY(Factor=series_2)
Z_2 = UnitZ(Factor=1)
multiplication_2 = Multiplication(A=Y, B=Slider(40, range=0..100))
multiplication_3 = Multiplication(A=Z_2, B=Slider(90, range=0..100))
panel = Panel(multiplication_2)
move_2 = Move(Geometry=rectangle.Rectangle, Motion=multiplication_2)  # -> Geometry, Transform
move_3 = Move(Geometry=move_2.Geometry, Motion=multiplication_3)  # -> Geometry, Transform
box_2 = DomainBox(Base=move_3.Geometry, X=Slider(5, range=0..100), Y=Slider(20, range=0..100), Z=Slider(5, range=0..100))

# ---- group: Rectangle 02
box_3 = DomainBox(Base=PlaneXY(0, 0, 0), X=Slider(100, range=0..1000), Y=Slider(200, range=0..1000), Z=Slider(100, range=0..100))
series_3 = Series(Start=0, Step=1, Count=Slider(12, range=0..100))
filedge_2 = FilletEdge(Shape=box_3, Blend=0, Metric=0, Edges=series_3, Radii=Slider(31, range=0..100))
xy_2 = XYPlane(Origin=Point(0, 0, 0))
Z_3 = UnitZ(Factor=1)
mirror_2 = Mirror(Geometry=filedge_2, Plane=xy_2)  # -> Geometry, Transform
multiplication_4 = Multiplication(A=Z_3, B=Slider(100, range=0..100))
rotate_2 = Rotate(Angle=1.570796327, Plane=PlaneXY(0, 0, 0))  # -> Geometry, Transform
move_4 = Move(Geometry=mirror_2.Geometry, Motion=multiplication_4)  # -> Geometry, Transform
debrep_2 = DeconstructBrep(Brep=box_3)  # -> Faces, Edges, Vertices
crv_2 = Curve(debrep_2.Edges)
cull_i_3 = CullIndex(
    List=debrep_2.Faces,
    Indices=[Slider(0, range=0..9), Slider(2, range=0..9), Slider(1, range=0..9), Slider(3, range=0..9)],
    Wrap=True)
curvepoint_2 = PointOnCurve(crv_2, parameter=1)
points_2 = PointList(Points=curvepoint_2, Size=Slider(10, range=0..10))

# ----
cyl = Cylinder(Base=PlaneXY(0, 0, 0), Radius=0.5, Length=1)

box_4 = DomainBox(Base=PlaneXY(0, 0, 0), X=Slider(100, range=0..100), Y=Slider(500, range=0..1000), Z=Slider(103, range=0..1000))
series_4 = Series(Start=0, Step=1, Count=Slider(4, range=0..100))
filedge_3 = FilletEdge(Shape=box_4, Blend=0, Metric=0, Edges=series_4, Radii=Slider(9, range=0..100))
Z_4 = UnitZ(Factor=1)
xy_3 = XYPlane(Origin=Point(0, 0, 0))
mirror_3 = Mirror(Geometry=filedge_3, Plane=xy_3)  # -> Geometry, Transform
multiplication_5 = Multiplication(A=Z_4, B=Slider(102, range=0..1000))
move_5 = Move(Geometry=mirror_3.Geometry, Motion=multiplication_5)  # -> Geometry, Transform
Y_2 = UnitY(Factor=1)
multiplication_6 = Multiplication(A=Y_2, B=Slider(990, range=0..1000))
move_6 = Move(Geometry=move_5.Geometry, Motion=multiplication_6)  # -> Geometry, Transform
debrep_3 = DeconstructBrep(Brep=move_6.Geometry)  # -> Faces, Edges, Vertices
crv_3 = Curve(debrep_3.Edges)
cull_i_4 = CullIndex(
    List=debrep_3.Faces,
    Indices=[Slider(1, range=0..9), Slider(3, range=0..9), Slider(6, range=0..9), Slider(8, range=0..9)],
    Wrap=True)
curvepoint_3 = PointOnCurve(crv_3, parameter=1)
points_3 = PointList(Points=curvepoint_3, Size=Slider(10, range=0..10))
material = CreateMaterial(
    Diffuse=ColourSwatch(SwatchColor=RGB(51, 51, 51)),
    Specular=RGB(255, 255, 255),
    Emission=RGB(0, 0, 0),
    Transparency=Slider(0, range=0..1),
    Shine=0)
preview = CustomPreview(Geometry=cull_i_4, Material=material)

X = UnitX(Factor=1)
multiplication_7 = Multiplication(A=X, B=Slider(95, range=0..100))
mjoin = MeshJoin(Meshes=box_2)

pop3d = Populate3D(Region=cull_i, Count=100, Seed=Slider(100, range=0..100))
random = Random(Range=Domain(0, 1), Number=1, Seed=2)
deplane = DeconstructPlane(Plane=pop3d)  # -> Origin, XAxis, YAxis, ZAxis
bnd = Bounds(Numbers=deplane.Origin)
remap = RemapNumbers(Value=deplane.Origin, Source=bnd, Target=Domain(0, 1))  # -> Mapped, Clipped
graph = GraphMapper(
    remap.Mapped,
    x0=0,
    x1=1,
    y0=0,
    y1=1,
    A=-2.107778186,
    B=1.603705697,
    container_name="Linear",
    Graph_x0=0.3235936761,
    Graph_x1=0.760851264,
    Graph_y0=0.9216420054,
    Graph_y1=0)
panel_2 = Panel(graph)
smaller = SmallerThan(FirstNumber=graph, SecondNumber=random)  # -> SmallerThan, OrEqualTo
number_slider = Slider(1, range=0..10)
cull = CullPattern(List=pop3d, CullPattern=smaller.SmallerThan)
rectangle_2 = Rectangle(Plane=cull, XSize=Domain(-1, 1), YSize=Domain(-2, 2), Radius=0)  # -> Rectangle, Length
cir = Circle(Plane=cull, Radius=number_slider)
sph = Sphere(Base=cull, Radius=number_slider)
boxrec = BoxRectangle(Rectangle=rectangle_2.Rectangle, Height=number_slider)
preview_2 = CustomPreview(Geometry=cir, Material=ColourSwatch(SwatchColor=RGB(0, 0, 0)))

preset = Preset(
    1,
    Has_Extract_Parameter=False,
    Has_Manage_Collection=False,
    OptionsLength=5,
    Version=1,
    Options=["Generic", "Plastic", "Paint", "Metal", "Glass"])
mjoin_2 = MeshJoin(Meshes=sph)
mtl_preset = VRayMaterialPreset(Preset=preset, MaterialBaseColorOrTexture=ColourSwatch(SwatchColor=RGB(224, 224, 224)))
out_img = OutputImage(
    "C:\Users\leah\Desktop\SHISHI\2.png",
    File_Picker=1,
    File_Types="Portable Network Graphics (*.png)|*.png|Windows bitmap (*.bmp)|*.bmp|Targa Image (*.tga)|*.tga|Radiance High-Dynamyc Range (*.hdr)|*.hdr|Silicon Graphics (*.sgi; *.rgb; *.rgba)|*.sgi;*.rgb;*.rgba|JPEG image (*.jpg; *.jpeg)|*.jpg;*.jpeg|OpenEXR image (*.exr)|*.exr|SoftImage PICT (*.pic)|*.pic|Tagged image (*.tif; *.tiff)|*.tif;*.tiff|Tiled mipmapped image file (*.tx)|*.tx|V-Ray Raw Image (*.vrimg)|*.vrimg",
    Multiple_Files=False)
quality = Quality(
    3,
    Has_Extract_Parameter=False,
    Has_Manage_Collection=False,
    OptionsLength=6,
    Version=1,
    Options=["Low", "Low+", "Medium", "Medium+", "High", "High+"])
sampler = Sampler(
    0,
    Has_Extract_Parameter=False,
    Has_Manage_Collection=False,
    OptionsLength=2,
    Version=1,
    Options=["Progressive", "Bucket"])
mode = Mode(
    1,
    Has_Extract_Parameter=False,
    Has_Manage_Collection=False,
    OptionsLength=2,
    Version=1,
    Options=["Interactive", "Production"])
engine = Engine(2, Has_Extract_Parameter=False, Has_Manage_Collection=False, OptionsLength=3, Version=1, Options=["CPU", "CUDA", "RTX"])
number_slider_2 = Slider(10, range=0..10)
random_2 = Random(Range=Slider(2, range=0..10), Number=number_slider_2, Seed=number_slider_2)
panel_3 = Panel(random_2)
cyl_2 = Cylinder(Base=PlaneXY(0, 0, 0), Radius=0.5, Length=1)

# ---- group: Right Lights
series_5 = Series(Start=Slider(0, range=0..1000), Step=Slider(2, range=0..100), Count=Slider(20, range=0..100))
Y_3 = UnitY(Factor=series_5)
Z_5 = UnitZ(Factor=1)
rectangle_3 = Rectangle(Plane=PlaneXY(0, 0, 0), XSize=Domain(-1, 1), YSize=Domain(-2, 2), Radius=0)  # -> Rectangle, Length
multiplication_8 = Multiplication(A=Y_3, B=Slider(40, range=0..100))
multiplication_9 = Multiplication(A=Z_5, B=Slider(90, range=0..100))
panel_4 = Panel(multiplication_8)
move_7 = Move(Geometry=rectangle_3.Rectangle, Motion=multiplication_8)  # -> Geometry, Transform
move_8 = Move(Geometry=move_7.Geometry, Motion=multiplication_9)  # -> Geometry, Transform

# ----
move_9 = Move(Geometry=move_8.Geometry, Motion=multiplication_7)  # -> Geometry, Transform

# ---- group: Right Lights (continued)
box_5 = DomainBox(Base=move_9.Geometry, X=Slider(5, range=0..100), Y=Slider(20, range=0..100), Z=Slider(5, range=0..100))

# ----
mjoin_3 = MeshJoin(Meshes=box_5)

number_slider_3 = Slider(10000, range=0..10000)
pop3d_2 = Populate3D(Region=cull_i_3, Count=number_slider_3, Seed=Slider(100, range=0..100))
random_3 = Random(Range=Domain(0, 1), Number=number_slider_3, Seed=2)
deplane_2 = DeconstructPlane(Plane=pop3d_2)  # -> Origin, XAxis, YAxis, ZAxis
bnd_2 = Bounds(Numbers=deplane_2.Origin)
remap_2 = RemapNumbers(Value=deplane_2.Origin, Source=bnd_2, Target=Domain(0, 1))  # -> Mapped, Clipped
graph_2 = GraphMapper(
    remap_2.Mapped,
    x0=0,
    x1=1,
    y0=0,
    y1=1,
    A=-2.107778186,
    B=1.603705697,
    container_name="Linear",
    Graph_x0=0.3235936761,
    Graph_x1=0.760851264,
    Graph_y0=0.9216420054,
    Graph_y1=0)
panel_5 = Panel(graph_2)
smaller_2 = SmallerThan(FirstNumber=graph_2, SecondNumber=random_3)  # -> SmallerThan, OrEqualTo
number_slider_4 = Slider(1, range=0..10)
cull_2 = CullPattern(List=pop3d_2, CullPattern=smaller_2.SmallerThan)
rectangle_4 = Rectangle(Plane=cull_2, XSize=Domain(-1, 1), YSize=Domain(-2, 2), Radius=0)  # -> Rectangle, Length
cir_2 = Circle(Plane=cull_2, Radius=number_slider_4)
boxrec_2 = BoxRectangle(Rectangle=rectangle_4.Rectangle, Height=number_slider_4)
sph_2 = Sphere(Base=cull_2, Radius=number_slider_4)
Y_4 = UnitY(Factor=1)
multiplication_10 = Multiplication(A=Slider(800, range=0..1000), B=Y_4)

cyl_3 = Cylinder(Base=cull_2, Radius=number_slider_4, Length=Slider(0.2, range=0..1))

move_10 = Move(Geometry=cyl_3, Motion=multiplication_10)  # -> Geometry, Transform
preview_3 = CustomPreview(Geometry=move_10.Geometry, Material=ColourSwatch(SwatchColor=RGB(0, 0, 0)))

mjoin_4 = MeshJoin(Meshes=move_10.Geometry)

debrep_4 = DeconstructBrep(Brep=cull_i_2)  # -> Faces, Edges, Vertices
number_slider_5 = Slider(15, range=0..100)
divide = DivideDomain²(Domain=debrep_4.Faces, UCount=number_slider_5, VCount=number_slider_5)
subsrf = Isotrim(Surface=debrep_4.Faces, Domain=divide)
panel_6 = Panel("""{?;0,2,...}[0,2,...]
{?;1,3,...}[1,3,...]""")
partition = PartitionList(List=subsrf, Size=number_slider_5)  # -> simplify(Chunks)
planar = IsPlanar(Surface=partition, Interior=True)  # -> Planar, Plane
number_slider_6 = Slider(10, range=0..30)
split = SplitTree(Data=planar.Plane, Masks=flatten(panel_6))  # -> Positive, Negative
clean = CleanTree(RemoveNulls=True, RemoveInvalid=True, RemoveEmpty=False, Tree=split.Positive)
popgeo = PopulateGeometry(Geometry=cull_i_2, Count=number_slider_6, Seed=Slider(7, range=0..30))
dist = Distance(PointA=popgeo, PointB=graft(clean))
dots = DotDisplay(Point=popgeo, Colour=ColourSwatch(SwatchColor=RGB(0, 107, 107)), Size=1)
sort = SortList(Keys=flatten(dist))  # -> reverse(Keys), ValuesA
dom = ConstructDomain(DomainStart=Slider(0, range=0..0.5), DomainEnd=Slider(0.37, range=0..0.5))
item = ListItem(List=sort.Keys, Index=0, Wrap=True)
random_4 = Random(Range=dom, Number=number_slider_6, Seed=Slider(32, range=0..100))
item_2 = ListItem(List=flatten(subsrf), Index=0, Wrap=True)
multiplication_11 = Multiplication(A=item, B=random_4)
edges = BrepEdges(Brep=item_2)  # -> Naked, Interior, NonManifold
min = Minimum(A=dist, B=multiplication_11)
item_3 = ListItem(List=edges.Naked, Index=0, Wrap=True)
ma = MassAddition(Input=min)  # -> Result, PartialResults
len = Length(Curve=item_3)
division = Division(A=len, B=Slider(2, range=1..2))
bnd_3 = Bounds(Numbers=flatten(ma.Result))
dom_2 = ConstructDomain(DomainStart=division, DomainEnd="0")
remap_3 = RemapNumbers(Value=ma.Result, Source=bnd_3, Target=dom_2)  # -> Mapped, Clipped
cir_3 = Circle(Plane=clean, Radius=Slider(3, range=0..10))

sph_3 = Sphere(Base=clean, Radius=random_2)
mjoin_5 = MeshJoin(Meshes=sph_3)
offset = OffsetCurve(Curve=cir_3, Distance=Slider(1, range=0..1), Corners=1)

preview_4 = CustomPreview(Geometry=[cir_3, sph_3], Material=ColourSwatch(SwatchColor=RGB(0, 0, 0)))

preview_5 = CustomPreview(Geometry=offset, Material=ColourSwatch(SwatchColor=RGB(0, 0, 0)))

number_slider_7 = Slider(5000, range=0..10000)
pop3d_3 = Populate3D(Region=cull_i, Count=number_slider_7, Seed=Slider(50, range=0..100))
random_5 = Random(Range=Domain(0, 1), Number=number_slider_7, Seed=2)
deplane_3 = DeconstructPlane(Plane=pop3d_3)  # -> Origin, XAxis, YAxis, ZAxis
bnd_4 = Bounds(Numbers=deplane_3.Origin)
remap_4 = RemapNumbers(Value=deplane_3.Origin, Source=bnd_4, Target=Domain(0, 1))  # -> Mapped, Clipped
graph_3 = GraphMapper(
    remap_4.Mapped,
    x0=0,
    x1=1,
    y0=0,
    y1=1,
    A=-1.500154398,
    B=1.402804958,
    container_name="Linear",
    Graph_x0=0.296300143,
    Graph_x1=0.9351070523,
    Graph_y0=0.9583089948,
    Graph_y1=0)
panel_7 = Panel(graph_3)
smaller_3 = SmallerThan(FirstNumber=graph_3, SecondNumber=random_5)  # -> SmallerThan, OrEqualTo
number_slider_8 = Slider(1, range=0..10)
number_slider_9 = Slider(2, range=0..10)
cull_3 = CullPattern(List=pop3d_3, CullPattern=smaller_3.SmallerThan)
rectangle_5 = Rectangle(Plane=cull_3, XSize=Domain(-1, 1), YSize=Domain(-2, 2), Radius=0)  # -> Rectangle, Length
cir_4 = Circle(Plane=cull_3, Radius=number_slider_9)
boxrec_3 = BoxRectangle(Rectangle=rectangle_5.Rectangle, Height=number_slider_9)
xz = XZPlane(Origin=Point(0, 0, 0))
sph_4 = Sphere(Base=cull_3, Radius=number_slider_9)
X_2 = UnitX(Factor=1)
multiplication_12 = Multiplication(A=X_2, B=Slider(100, range=0..1000))

cyl_4 = Cylinder(Base=cull_3, Radius=Slider(2, range=0..10), Length=Slider(0.2, range=0..1))

rotate_3 = Rotate(Geometry=cyl_4, Angle=1.570796327, Plane=xz)  # -> Geometry, Transform
move_11 = Move(Geometry=rotate_3.Geometry, Motion=multiplication_12)  # -> Geometry, Transform
preview_6 = CustomPreview(Geometry=move_11.Geometry, Material=ColourSwatch(SwatchColor=RGB(0, 0, 0)))

mjoin_6 = MeshJoin(Meshes=move_11.Geometry)

number_slider_10 = Slider(5000, range=0..10000)
pop3d_4 = Populate3D(Region=cull_i, Count=number_slider_10, Seed=Slider(50, range=0..100))
random_6 = Random(Range=Domain(0, 1), Number=number_slider_10, Seed=2)
deplane_4 = DeconstructPlane(Plane=pop3d_4)  # -> Origin, XAxis, YAxis, ZAxis
bnd_5 = Bounds(Numbers=deplane_4.Origin)
remap_5 = RemapNumbers(Value=deplane_4.Origin, Source=bnd_5, Target=Domain(0, 1))  # -> Mapped, Clipped
graph_4 = GraphMapper(
    remap_5.Mapped,
    x0=0,
    x1=1,
    y0=0,
    y1=1,
    A=-1.500154398,
    B=1.402804958,
    container_name="Linear",
    Graph_x0=0.296300143,
    Graph_x1=0.9351070523,
    Graph_y0=0.9583089948,
    Graph_y1=0)
panel_8 = Panel(graph_4)
smaller_4 = SmallerThan(FirstNumber=graph_4, SecondNumber=random_6)  # -> SmallerThan, OrEqualTo
number_slider_11 = Slider(1, range=0..10)
number_slider_12 = Slider(2, range=0..10)
cull_4 = CullPattern(List=pop3d_4, CullPattern=smaller_4.SmallerThan)
rectangle_6 = Rectangle(Plane=cull_4, XSize=Domain(-1, 1), YSize=Domain(-2, 2), Radius=0)  # -> Rectangle, Length
cir_5 = Circle(Plane=cull_4, Radius=number_slider_12)
boxrec_4 = BoxRectangle(Rectangle=rectangle_6.Rectangle, Height=number_slider_12)
xz_2 = XZPlane(Origin=Point(0, 0, 0))
sph_5 = Sphere(Base=cull_4, Radius=number_slider_12)
X_3 = UnitX(Factor=1)
multiplication_13 = Multiplication(A=X_3, B=Slider(100, range=0..1000))

cyl_5 = Cylinder(Base=cull_4, Radius=Slider(2, range=0..10), Length=Slider(0.2, range=0..1))

rotate_4 = Rotate(Geometry=cyl_5, Angle=1.570796327, Plane=xz_2)  # -> Geometry, Transform
move_12 = Move(Geometry=rotate_4.Geometry, Motion=multiplication_13)  # -> Geometry, Transform
preview_7 = CustomPreview(Geometry=move_12.Geometry, Material=ColourSwatch(SwatchColor=RGB(0, 0, 0)))

mjoin_7 = MeshJoin(Meshes=move_12.Geometry)

number_slider_13 = Slider(10000, range=0..10000)
pop3d_5 = Populate3D(Region=cull_i_3, Count=number_slider_13, Seed=Slider(100, range=0..100))
random_7 = Random(Range=Domain(0, 1), Number=number_slider_13, Seed=2)
deplane_5 = DeconstructPlane(Plane=pop3d_5)  # -> Origin, XAxis, YAxis, ZAxis
bnd_6 = Bounds(Numbers=deplane_5.Origin)
remap_6 = RemapNumbers(Value=deplane_5.Origin, Source=bnd_6, Target=Domain(0, 1))  # -> Mapped, Clipped
graph_5 = GraphMapper(
    remap_6.Mapped,
    x0=0,
    x1=1,
    y0=0,
    y1=1,
    A=-1.475907811,
    B=1.380131802,
    container_name="Linear",
    Graph_x0=0.2575579584,
    Graph_x1=0.9351070523,
    Graph_y0=1,
    Graph_y1=0)
panel_9 = Panel(graph_5)
smaller_5 = SmallerThan(FirstNumber=graph_5, SecondNumber=random_7)  # -> SmallerThan, OrEqualTo
cull_5 = CullPattern(List=pop3d_5, CullPattern=smaller_5.SmallerThan)
number_slider_14 = Slider(2, range=0..10)
rectangle_7 = Rectangle(Plane=cull_5, XSize=Domain(-1, 1), YSize=Domain(-2, 2), Radius=0)  # -> Rectangle, Length
cir_6 = Circle(Plane=cull_5, Radius=number_slider_14)
boxrec_5 = BoxRectangle(Rectangle=rectangle_7.Rectangle, Height=number_slider_14)
sph_6 = Sphere(Base=cull_5, Radius=number_slider_14)
xz_3 = XZPlane(Origin=Point(0, 0, 0))
X_4 = UnitX(Factor=1)
multiplication_14 = Multiplication(A=X_4, B=Slider(100, range=0..100))
Y_5 = UnitY(Factor=1)
multiplication_15 = Multiplication(A=Slider(800, range=0..1000), B=Y_5)

cyl_6 = Cylinder(Base=cull_5, Radius=number_slider_14, Length=Slider(0.3, range=0..1))

rotate_5 = Rotate(Geometry=cyl_6, Angle=1.570796327, Plane=xz_3)  # -> Geometry, Transform
move_13 = Move(Geometry=rotate_5.Geometry, Motion=multiplication_14)  # -> Geometry, Transform
move_14 = Move(Geometry=move_13.Geometry, Motion=multiplication_15)  # -> Geometry, Transform
preview_8 = CustomPreview(Geometry=move_14.Geometry, Material=ColourSwatch(SwatchColor=RGB(0, 0, 0)))

vgeo = VRayGeometry(
    Geo=[move_14.Geometry, cull_i_4, move_10.Geometry, move_12.Geometry, move_11.Geometry, sph, sph_3],
    Material=mtl_preset,
    Visible=True,
    quality=0)  # disabled
render = VRayRender(
    Engine=engine,
    Mode=mode,
    Sampler=sampler,
    Quality=quality,
    OutputImage=out_img,
    OutputResolution=[1920, 1080],
    VGeometry=flatten(vgeo),
    UpdateEffectsFrequency=100)  # disabled
mjoin_8 = MeshJoin(Meshes=move_14.Geometry)
